# Grasshopper definition grasshopper_script.gh (Grasshopper 1.0.7)

division = Division(A=Slider(40, range=0..100), B=2)

movingspeed_vertical_level_offset = Slider(0.25, range=0..1)
nutrient = Slider(0.05, range=0..1)
vectorscalingratio = Slider(0.1, range=0..1)
looprepeat = Slider(60, range=0..1000)
pointculltolerance = Slider(0.1, range=0..1)
randomness = Slider(0.1, range=0..10)
toxicity = Slider(0.05, range=0..1)
num = Number(randomness)

numberofpoints = Slider(144, range=0..1000)
negative = Negative(Value=division)
seed = Slider(289, range=0..1000)
construct_domain = ConstructDomain(DomainStart=division, DomainEnd=negative)
vector_xyz = VectorXYZ(XComponent=Slider(0, range=-100..101), YComponent=Slider(0, range=0..100), ZComponent=0)  # -> Vector, Length
rectangle = Rectangle(Plane=PlaneXY(0, 0, 0), XSize=construct_domain, YSize=construct_domain, Radius=0)  # -> Rectangle, Length
move = Move(Geometry=rectangle.Rectangle, Motion=vector_xyz.Vector)  # -> Geometry, Transform
R = Region(move.Geometry)
integer = Integer(numberofpoints)
integer_2 = Integer(seed)
pop2d = Populate2D(Region=R, Count=integer, Seed=integer_2)
pt = Point(pop2d)
lng = ListLength(List=pt)

addition = Addition(Repetition=looprepeat, B="1")
series = Series(Start0=0, MovingSpeed=movingspeed_vertical_level_offset, NumberOfTotalCurve=addition)
Z = UnitZ(Factor=graft(series))
# GET THE POINTS Directly from Rhinoceros Layers
vector = Vector(Z)

c_script = CSharpScript()  # -> out, FoodPoints, PosionPoints
# ---------- c_script: C# ----------
    var foodLayer = "Food";
    Rhino.DocObjects.RhinoObject[] rhinoFoodObjects = doc.Objects.FindByLayer(foodLayer);
    List<Point3d> foodPoints = new List<Point3d>();
    
    var poisonLayer = "Poison";
    Rhino.DocObjects.RhinoObject[] rhinoPoisonObjects = doc.Objects.FindByLayer(poisonLayer);
    List<Point3d> poisonPoints = new List<Point3d>();

    Point3d pt = Point3d.Unset;

    
    foreach (Rhino.DocObjects.RhinoObject rhObj in rhinoFoodObjects)
    {
      var tempP = rhObj.Geometry;
      
      if(tempP is Rhino.Geometry.Point)
      {
        pt = ((Rhino.Geometry.Point) tempP).Location;
        
        Print("Food Geometry {0}", pt);
        foodPoints.Add(pt);
      }
    }
    
    foreach (Rhino.DocObjects.RhinoObject rhObj in rhinoPoisonObjects)
    {
      var tempP = rhObj.Geometry;
      
      if(tempP is Rhino.Geometry.Point)
      {
        pt = ((Rhino.Geometry.Point) tempP).Location;
        
        Print("Poison Geometry {0}", pt);
        poisonPoints.Add(pt);
      }
    }



    FoodPoints = foodPoints;
    PosionPoints = poisonPoints;
# ---------- end c_script ----------
posionpoints = Panel(c_script.PosionPoints)
foodpoints = Panel(c_script.FoodPoints)

# ---- group: Poison
# Move The points
# whlie generation continues
pt_2 = Point(c_script.PosionPoints)

# ---- group: foodsource
# Move The points
# whlie generation continues
pt_3 = Point(c_script.FoodPoints)

# ----
colour_swatch = ColourSwatch(SwatchColor=RGB(0, 255, 0))
circle = Circle(Plane=pt_3, Radius=Slider(0.5, range=0..1))
circle_2 = Circle(Plane=pt_2, Radius=Slider(1, range=0..1))
surface = Surface(circle)
surface_2 = Surface(circle_2)
text_tag_3d = TextTag3D(Location=pt_2, Text="Poison", Size=1, Justification=2)
custom_preview = CustomPreview(Geometry=surface, Material=colour_swatch)
text_tag_3d_2 = TextTag3D(Location=pt_3, Text="Food", Size=1, Colour=colour_swatch, Justification=2)
custom_preview_2 = CustomPreview(Geometry=surface_2, Material=ColourSwatch(SwatchColor=RGB(255, 0, 0)))

# ----
# SET The Timer
# Open For Generating
# 
# !! Close Trigger when the Generation is done !!
trigger = Trigger(Interval=2000, TimerInterval=2000, Target=[c_script_2, c_script])

# ----
# RUN OR STOP THE SCRIPT
# Restart/Reset
run_stop = BooleanToggle(True)
reset = Button()
point = Point(pt)
number = Number(movingspeed_vertical_level_offset)
nutrient_2 = Number(nutrient)
nutrient_3 = Number(toxicity)
number_2 = Number(vectorscalingratio)
number_3 = Number(pointculltolerance)
integer_3 = Integer(looprepeat)
num_2 = Number(num)
c_script_2 = CSharpScript(
    Run=run_stop,
    reset=reset,
    InitialPointList=point,
    VerticalLevelOffset=number,
    RandomnessInterval=num_2,
    NutrientImpact=nutrient_2,
    ToxicityImpact=nutrient_3,
    VectorScalingRatio=number_2,
    PointCullTolerance=number_3,
    LoopRepeat=integer_3)  # -> out, FinalPoints; inputs Run: Boolean, reset: Boolean, InitialPointList: list of Point3d, VerticalLevelOffset: Double, RandomnessInterval: Double, NutrientImpact: Double, ToxicityImpact: Double, VectorScalingRatio: Double, PointCullTolerance: Double, LoopRepeat: Int32, RunStop: Boolean
# ---------- c_script_2: C# usings ----------
// Author: MustafaCem Gunes
// The code is created by re-writing visual Grasshopper script Of Michele Chem
// mcemgunes@gmail.com

using System.Linq;
# ---------- c_script_2: C# ----------
    if(reset == true)
    {
      timer = 0;
      FinalPointNestedList = new List <List<Point3d>>();

      LastPointList = new List<Point3d>();

    }

    List<Point3d> TempPointList = new List<Point3d>();

/*
    List < Vector3d> ClosestPointVectorList = new List < Vector3d> ();
    List < Vector3d> ClosestFoodVector = new List < Vector3d> ();
    List < Vector3d> ClosestPoisonVector = new List < Vector3d> ();
*/
    Vector3d VerticalOffsetVector = new Vector3d (0, 0, VerticalLevelOffset);
    Vector3d VectorToClosestPoint = new Vector3d ();

    Vector3d VectorToClosestFoodPoint = new Vector3d ();
    Vector3d VectorToClosestPoisonPoint = new Vector3d (); // it is negative vector. Get Away!

    List<double> FoodDistanceList = new List<double>();
    List<double> PoisonDistanceList = new List<double>();

    //var LastPointList = InitialPointList;

    int closestPointIndex = -100000;
    int closestFoodIndex = -100000;
    int closestPoisonIndex = -100000;


    IEnumerable<Int32[]> ClosestPointIndexArrays = null;
    IEnumerable<Int32[]> ClosestPoisonIndexArrays = null;
    IEnumerable<Int32[]> ClosestFoodIndexArrays = null;

    Point3d currentPointPosition = new Point3d();


    //int counter = 0;

    //List<int[]>  ClosestPointIndexArrays = new List<int[]>();
    
    
    
    var foodLayer = "Food";
    Rhino.DocObjects.RhinoObject[] rhinoFoodObjects = doc.Objects.FindByLayer(foodLayer);
    List<Point3d> foodPoints = new List<Point3d>();

    var poisonLayer = "Poison";
    Rhino.DocObjects.RhinoObject[] rhinoPoisonObjects = doc.Objects.FindByLayer(poisonLayer);
    List<Point3d> poisonPoints = new List<Point3d>();

    Point3d pt = Point3d.Unset;


    
    
    
    
    

    if(Run == true)
    {
      if(timer == 0 ){

        FinalPointNestedList.Add(InitialPointList);
        LastPointList = InitialPointList;
      }

      if (timer < LoopRepeat)
      {
        if(timer != 0 )
        {
          LastPointList = FinalPointNestedList[FinalPointNestedList.Count - 1];
        }
        
        
        // GET THE POINTS FROM RHINOCEROS LAYERS
        
         poisonPoints = new List<Point3d>();
         foodPoints = new List<Point3d>();

        foreach (Rhino.DocObjects.RhinoObject rhObj in rhinoFoodObjects)
        {
          var tempP = rhObj.Geometry;

          if(tempP is Rhino.Geometry.Point)
          {
            pt = ((Rhino.Geometry.Point) tempP).Location;

            Print("Food Geometry {0}", pt);
            foodPoints.Add(pt);
          }
        }

        foreach (Rhino.DocObjects.RhinoObject rhObj in rhinoPoisonObjects)
        {
          var tempP = rhObj.Geometry;

          if(tempP is Rhino.Geometry.Point)
          {
            pt = ((Rhino.Geometry.Point) tempP).Location;

            Print("Poison Geometry {0}", pt);
            poisonPoints.Add(pt);
          }
        }
    
        // GET THE POINTS FROM RHINOCEROS LAYERS


        ClosestPointIndexArrays = RTree.Point3dKNeighbors(LastPointList, LastPointList, 2);
        ClosestFoodIndexArrays = RTree.Point3dKNeighbors(foodPoints, LastPointList, 1);
        ClosestPoisonIndexArrays = RTree.Point3dKNeighbors(poisonPoints, LastPointList, 1);

        TempPointList = new List<Point3d>();
        FoodDistanceList = new List<double>();
        PoisonDistanceList = new List<double>();


        // RE-SORT FOOD Amplitude
        for (int k = 0 ; k < LastPointList.Count ;k++)

        {
          closestFoodIndex = (ClosestFoodIndexArrays.ElementAt(k))[0];

          FoodDistanceList.Add(LastPointList[k].DistanceTo(foodPoints[closestFoodIndex]));
          FoodDistanceList.Sort();
          // RE-SORT FOOD Amplitude
          closestFoodIndex = (ClosestFoodIndexArrays.ElementAt(k))[0];

          FoodDistanceList.Add(LastPointList[k].DistanceTo(foodPoints[closestFoodIndex]));
          // RE-SORT Poison Amplitude

          closestPoisonIndex = (ClosestPoisonIndexArrays.ElementAt(k))[0];

          PoisonDistanceList.Add(LastPointList[k].DistanceTo(poisonPoints[closestPoisonIndex]));
          PoisonDistanceList.Sort();
          // RE-SORT FOOD Amplitude
          closestPoisonIndex = (ClosestPoisonIndexArrays.ElementAt(k))[0];
          //Print("Closest Food Source Index {0}", closestPoisonIndex.ToString());

          PoisonDistanceList.Add(LastPointList[k].DistanceTo(poisonPoints[closestPoisonIndex]));
        }

        FoodDistanceList.Sort();
        FoodDistanceList.Reverse();

        PoisonDistanceList.Sort();
        FoodDistanceList.Reverse();

        for (int j = 0 ; j < LastPointList.Count ;j++)

        {
          // Random Vector generator //

          // ( from  -RandomnessInterval to + RandomInterval ) //

          Random rX = new Random(timer + j);
          Random rY = new Random(timer + 1 + j);

          double range = RandomnessInterval;
          double rDoubleX = (rX.NextDouble() * range * 2) - RandomnessInterval;
          double rDoubleY = (rY.NextDouble() * range * 2) - RandomnessInterval;

          var RandomVector = new Vector3d(rDoubleX, rDoubleY, 0);
          //Print("Random X: {0}, Random Y: {1} ", rDoubleX, rDoubleY);

          // Random Vector generator //

          //RANDOM DONE

          // Get Current Point
          currentPointPosition = LastPointList[j];


          closestPointIndex = (ClosestPointIndexArrays.ElementAt(j))[1];
          //Print("Closest Neigbour Point index counter = {0} index: {1}", j, closestPointIndex);

          VectorToClosestPoint = new Vector3d(currentPointPosition - LastPointList[closestPointIndex]);
          // Print("Point {0} Closest Neigbour Point index  = {1}", j, closestPointIndex);

          VectorToClosestPoint.Z = 0;
          // Print("Closest Point Vector {0}", VectorToClosestPoint);

          closestFoodIndex = (ClosestFoodIndexArrays.ElementAt(j))[0];
          //Print("Closest Food Source Index {0}", closestFoodIndex.ToString());

          VectorToClosestFoodPoint = new Vector3d(currentPointPosition - foodPoints[closestFoodIndex]);
          VectorToClosestFoodPoint.Z = 0;

          VectorToClosestFoodPoint.Unitize();
          VectorToClosestFoodPoint = Vector3d.Multiply(VectorToClosestFoodPoint, NutrientImpact * FoodDistanceList[j]);

          // Print("Closest Food Vector  {0}", VectorToClosestFoodPoint.ToString());

          closestPoisonIndex = (ClosestPoisonIndexArrays.ElementAt(j))[0];

          VectorToClosestPoisonPoint = new Vector3d(currentPointPosition - poisonPoints[closestPoisonIndex]);
          VectorToClosestPoisonPoint.Z = 0;

          VectorToClosestPoisonPoint.Unitize();
          VectorToClosestPoisonPoint = Vector3d.Multiply(VectorToClosestPoisonPoint, (ToxicityImpact * PoisonDistanceList[j] * -1));
          //Print("Closest Toxix Vector  {0}", VectorToClosestPoisonPoint.ToString());


          TempPointList.Add(
            (

            -VectorToClosestPoint
            - VectorToClosestPoisonPoint
            - VectorToClosestFoodPoint
            - RandomVector
            //+RandomVector

            ) * VectorScalingRatio // DONE

            + VerticalOffsetVector // DONE
            + currentPointPosition// DONE

            )
            ;

          Print("     ---\n");
        }

        var culledPointArray = Point3d.CullDuplicates(TempPointList, PointCullTolerance);

        if( culledPointArray.GetLength(0) < (InitialPointList.Count / 4 ) )
        {
          Print("Not Enough Point STOPEED! STEP :{0}", timer);
          goto breakTheLoop;
        }

        else
        {
          TempPointList = ArrayToListPoint3D(culledPointArray);
        }
        FinalPointNestedList.Add(TempPointList);
        timer++;
        Print("timer :{0} ", timer);
      }

      else if (timer == LoopRepeat)

      {Print(" Run is limited by LoopRepeat Parameter.! Loop: {0}  Limit: {1}", timer, LoopRepeat);}
    }
    breakTheLoop:
      var FinalPointsDT = ListToTreePoint3d(FinalPointNestedList);

    FinalPoints = FinalPointsDT;
# ---------- c_script_2: C# additional code ----------
  int timer = 0;
  List<List<Point3d>> FinalPointNestedList = new List <List<Point3d>>();

  List<Point3d> LastPointList = new List<Point3d>();




  public Grasshopper.DataTree<Point3d>  ListToTreePoint3d (List<List<Point3d>> NestedList)
  {
    Grasshopper.DataTree<Point3d> tree = new Grasshopper.DataTree<Point3d>();
    for (int i = 0; i < NestedList.Count  ; i++)
    {
      for (int j = 0 ; j < NestedList[i].Count; j++)
      {
        GH_Path path = new GH_Path(i, j);
        tree.Add(NestedList[i][j], path);
      }
    }
    return tree;
  }

  public List<Point3d> ArrayToListPoint3D(Point3d[] pointArray)
  {
    List < Point3d> tempList = new List < Point3d> ();
    foreach( var p in pointArray )
    {
      tempList.Add(p);
    }
    return tempList;
  }
# ---------- end c_script_2 ----------
panel = Panel(c_script_2.out)
point_2 = Point(c_script_2.FinalPoints)
panel_2 = Panel(point_2)
point_3 = Point(point_2)
trim_tree = TrimTree(Tree=point_3, Depth=1)
point_4 = Point(trim_tree)
group = Group(Objects=point_4)  # -> flatten(Group)
lng_2 = ListLength(List=point_4)
metaballfinalsize = Slider(4.97, range=0..10)
division_2 = Division(TotalPointNumber=lng, B=lng_2)
sqrt = SquareRoot(Value=division_2)
dom = ConstructDomain(DomainStart=Slider(1, range=0..1), DomainEnd=metaballfinalsize)
bnd = Bounds(Numbers=flatten(sqrt))
remap = RemapNumbers(Value=sqrt, Source=bnd, Target=dom)  # -> Mapped, Clipped
vector_2 = Vector(vector)
division_3 = Division(A=Slider(1.3, range=0..10), B=division_2)
ungroup = Ungroup(Group=group)
metaball_t = MetaBallT(Points=simplify(ungroup), Plane=simplify(vector_2), Threshold=division_3)
# CLOSE TRIGGER
# Before Activating
# Extrusions
panel_3 = Panel(division_3)
voronoi = Voronoi(Points=point_4, Radius=sqrt, Plane=vector_2, BruteForceOverride=False)  # disabled
swatch = ColourSwatch(SwatchColor=RGB(28, 28, 28))
crv = Curve(metaball_t)
preview = CustomPreview(Geometry=metaball_t, Material=swatch)
preview_2 = CustomPreview(Geometry=voronoi, Material=swatch)  # disabled
number_slider = Slider(31, range=0..100)

number_slider_2 = Slider(0.8, range=0..1)  # disabled
area = Area(Geometry=metaball_t)  # -> Area, Centroid
scale = Scale(Geometry=metaball_t, Center=area.Centroid, Factor=number_slider_2)  # -> Geometry, Transform; disabled
number_slider_3 = Slider(0.25, range=-0.5..0.5)  # disabled
merge = Merge(Data1=graft(scale.Geometry), Data2=graft(crv))  # disabled
loft = Loft(Curves=merge, Options={Adjust=False, Closed=False, LoftEnds=0, LoftSimp=0, LoftType=0, Rebuild=10, Refit=0.01})  # disabled
Z_2 = UnitZ(Factor=number_slider_3)  # disabled
extr = Extrude(Base=loft, Direction=Z_2)  # disabled

group_2 = Group(Objects=metaball_t)
group_3 = Group(Objects=voronoi)  # -> flatten(Group); disabled

number_slider_4 = Slider(0.1, range=0..0.1)  # disabled
cir = Circle(Plane=PlaneXY(0, 0, 0), Radius=number_slider_4)  # disabled
number_slider_5 = Slider(10, range=0..10)  # disabled
X = UnitX(Factor=1)  # disabled
rot3d = Rotate3D(Geometry=cir, Angle=1.570796327, Center=Point(0, 0, 0), Axis=X)  # -> Geometry, Transform; disabled
cir_2 = Circle(Plane=PlaneXY(0, 0, 0), Radius=number_slider_5)  # disabled
extrcrv = ExtrudeAlong(Base=rot3d.Geometry, Curve=cir_2)  # disabled
extrcrv_2 = ExtrudeAlong(Base=rot3d.Geometry, Curve=flatten(crv))  # disabled

number_4 = Number(movingspeed_vertical_level_offset)  # disabled
vector_xyz_2 = VectorXYZ(XComponent=0, YComponent=0, ZComponent=number_4)  # -> Vector, Length; disabled
boundary_surfaces = BoundarySurfaces(Edges=metaball_t)  # disabled
extrude = Extrude(Base=boundary_surfaces, Direction=vector_xyz_2.Vector)  # disabled

panel_4 = Panel("-1")  # disabled
item = ListItem(List=flatten(group_2), Index=panel_4, Wrap=True)  # disabled
item_2 = ListItem(List=flatten(group_2), Index=number_slider, Wrap=False)  # disabled
item_3 = ListItem(List=group_3, Index=number_slider, Wrap=False)  # disabled
item_4 = ListItem(List=group_3, Index=panel_4, Wrap=True)  # disabled
preview_3 = CustomPreview(Geometry=item, Material=swatch)  # disabled
